# Dynamo graph Update Parameter Value.dyn (Dynamo 3.0.3.7597)

categories = Categories()  # nothing selected; graph input
all_elements_of_category = ElementsOfCategory(Category=categories)
INPUT_ParameterName = StringInput("")  # graph input
INPUT_Value = StringInput("")  # graph input
setParameterByName = Element.SetParameterByName(element=all_elements_of_category, parameterName=INPUT_ParameterName, value=INPUT_Value)  # graph output
